# Grasshopper definition TCB_Design_Editor.gh (Grasshopper 1.0.8)
# plug-ins: Heteroptera, Human UI, Human, LunchBox, eleFront

# ---- group: 9
button = CreateButton(ButtonName="Reset", ButtonStyle=0)
values = ValueListener(Elements=button, SomeProperty=True)  # -> Values, Indices
pickbtn = CreateRhinoPickButton(ButtonName="9", Prompt="Please select geometry...", AllowMultiple=True, AllowNone=values.Values, Type=0, ButtonStyle=0)
values_2 = ValueListener(Elements=pickbtn, SomeProperty=True)  # -> Values, Indices
stack = CreateStack(UIElements=[pickbtn, button], Horizontal=True)

# ---- group: 1
button_2 = CreateButton(ButtonName="Reset", ButtonStyle=0)
values_3 = ValueListener(Elements=button_2, SomeProperty=True)  # -> Values, Indices
# Interconnect Buttons UI
pickbtn_2 = CreateRhinoPickButton(ButtonName="1", Prompt="Please select geometry...", AllowMultiple=True, AllowNone=values_3.Values, Type=0, ButtonStyle=0)
values_4 = ValueListener(Elements=pickbtn_2, SomeProperty=True)  # -> Values, Indices
stack_2 = CreateStack(UIElements=[pickbtn_2, button_2], Horizontal=True)

# ---- group: 11
button_3 = CreateButton(ButtonName="Reset", ButtonStyle=0)
values_5 = ValueListener(Elements=button_3, SomeProperty=True)  # -> Values, Indices
pickbtn_3 = CreateRhinoPickButton(
    ButtonName="11",
    Prompt="Please select geometry...",
    AllowMultiple=True,
    AllowNone=values_5.Values,
    Type=0,
    ButtonStyle=0)
values_6 = ValueListener(Elements=pickbtn_3, SomeProperty=True)  # -> Values, Indices
stack_3 = CreateStack(UIElements=[pickbtn_3, button_3], Horizontal=True)

# ---- group: 2
button_4 = CreateButton(ButtonName="Reset", ButtonStyle=0)
values_7 = ValueListener(Elements=button_4, SomeProperty=True)  # -> Values, Indices
pickbtn_4 = CreateRhinoPickButton(ButtonName="2", Prompt="Please select geometry...", AllowMultiple=True, AllowNone=values_7.Values, Type=0, ButtonStyle=0)
values_8 = ValueListener(Elements=pickbtn_4, SomeProperty=True)  # -> Values, Indices
stack_4 = CreateStack(UIElements=[pickbtn_4, button_4], Horizontal=True)

# ---- group: 3
button_5 = CreateButton(ButtonName="Reset", ButtonStyle=0)
values_9 = ValueListener(Elements=button_5, SomeProperty=True)  # -> Values, Indices
pickbtn_5 = CreateRhinoPickButton(ButtonName="3", Prompt="Please select geometry...", AllowMultiple=True, AllowNone=values_9.Values, Type=0, ButtonStyle=0)
values_10 = ValueListener(Elements=pickbtn_5, SomeProperty=True)  # -> Values, Indices
stack_5 = CreateStack(UIElements=[pickbtn_5, button_5], Horizontal=True)

# ---- group: 10
button_6 = CreateButton(ButtonName="Reset", ButtonStyle=0)
values_11 = ValueListener(Elements=button_6, SomeProperty=True)  # -> Values, Indices
pickbtn_6 = CreateRhinoPickButton(
    ButtonName="10",
    Prompt="Please select geometry...",
    AllowMultiple=True,
    AllowNone=values_11.Values,
    Type=0,
    ButtonStyle=0)
values_12 = ValueListener(Elements=pickbtn_6, SomeProperty=True)  # -> Values, Indices
stack_6 = CreateStack(UIElements=[pickbtn_6, button_6], Horizontal=True)

# ---- group: 8
button_7 = CreateButton(ButtonName="Reset", ButtonStyle=0)
values_13 = ValueListener(Elements=button_7, SomeProperty=True)  # -> Values, Indices
pickbtn_7 = CreateRhinoPickButton(
    ButtonName="8",
    Prompt="Please select geometry...",
    AllowMultiple=True,
    AllowNone=values_13.Values,
    Type=0,
    ButtonStyle=0)
values_14 = ValueListener(Elements=pickbtn_7, SomeProperty=True)  # -> Values, Indices
stack_7 = CreateStack(UIElements=[pickbtn_7, button_7], Horizontal=True)

# ---- group: 4
button_8 = CreateButton(ButtonName="Reset", ButtonStyle=0)
values_15 = ValueListener(Elements=button_8, SomeProperty=True)  # -> Values, Indices
pickbtn_8 = CreateRhinoPickButton(
    ButtonName="4",
    Prompt="Please select geometry...",
    AllowMultiple=True,
    AllowNone=values_15.Values,
    Type=0,
    ButtonStyle=0)
values_16 = ValueListener(Elements=pickbtn_8, SomeProperty=True)  # -> Values, Indices
stack_8 = CreateStack(UIElements=[pickbtn_8, button_8], Horizontal=True)

# ---- group: 7
button_9 = CreateButton(ButtonName="Reset", ButtonStyle=0)
values_17 = ValueListener(Elements=button_9, SomeProperty=True)  # -> Values, Indices
pickbtn_9 = CreateRhinoPickButton(
    ButtonName="7",
    Prompt="Please select geometry...",
    AllowMultiple=True,
    AllowNone=values_17.Values,
    Type=0,
    ButtonStyle=0)
values_18 = ValueListener(Elements=pickbtn_9, SomeProperty=True)  # -> Values, Indices
stack_9 = CreateStack(UIElements=[pickbtn_9, button_9], Horizontal=True)

# ---- group: 5
button_10 = CreateButton(ButtonName="Reset", ButtonStyle=0)
values_19 = ValueListener(Elements=button_10, SomeProperty=True)  # -> Values, Indices
pickbtn_10 = CreateRhinoPickButton(
    ButtonName="5",
    Prompt="Please select geometry...",
    AllowMultiple=True,
    AllowNone=values_19.Values,
    Type=0,
    ButtonStyle=0)
values_20 = ValueListener(Elements=pickbtn_10, SomeProperty=True)  # -> Values, Indices
stack_10 = CreateStack(UIElements=[pickbtn_10, button_10], Horizontal=True)

# ---- group: 6
button_11 = CreateButton(ButtonName="Reset", ButtonStyle=0)
values_21 = ValueListener(Elements=button_11, SomeProperty=True)  # -> Values, Indices
pickbtn_11 = CreateRhinoPickButton(
    ButtonName="6",
    Prompt="Please select geometry...",
    AllowMultiple=True,
    AllowNone=values_21.Values,
    Type=0,
    ButtonStyle=0)
values_22 = ValueListener(Elements=pickbtn_11, SomeProperty=True)  # -> Values, Indices
stack_11 = CreateStack(UIElements=[pickbtn_11, button_11], Horizontal=True)

# ----
pt = Point()

# ----
# Add Gemoetry & Reset UI
panel = Panel("Add Geometry")
button_12 = CreateButton(ButtonName="Reset", ButtonStyle=0)
values_23 = ValueListener(Elements=button_12, SomeProperty=True)  # -> Values, Indices
pickbtn_12 = CreateRhinoPickButton(
    ButtonName=panel,
    Prompt="Please select geometry...",
    AllowMultiple=True,
    AllowNone=values_23.Values,
    Type=0,
    ButtonStyle=0)
values_24 = ValueListener(Elements=pickbtn_12, SomeProperty=True)  # -> Values, Indices
brep = Brep(values_24.Values)
stack_12 = CreateStack(UIElements=[pickbtn_12, button_12], Horizontal=True)
colour = ColourPicker(PickedColour=RGBA(212, 108, 70, 133))
preview = CustomPreview(Geometry=brep, Material=colour)

# ----
# Pitch Dimension UI
pitch_dimension = Slider(2.5, range=0.1..4.1)
slider = CreateSlider(Slider=pitch_dimension, ShowBounds=False, ShowTicks=False, ShowTooltip=False, ShowValLabel=True, showLabel=True)
values_25 = ValueListener(Elements=slider, SomeProperty=True)  # -> PitchDimension, Indices

# ----
# Launch Window
height = Slider(684, range=0..1000)
launchwin = LaunchWindow(
    Show=Toggle(True),
    Name="TCB Design Editor",
    Width=Slider(500, range=0..1000),
    Height=height,
    ChildStatus=1,
    EnableHorizScroll=False)

# ----
# Preview of Nodes
panel_2 = Panel("Preview of Nodes")
create_toggle = CreateToggle(Default=False, Label=panel_2)
value_listener = ValueListener(Elements=create_toggle, SomeProperty=True)  # -> Values, Indices
gate_not = GateNot(A=value_listener.Values)

# ----
# Add Sockets UI
panel_3 = Panel("Add Sockets")
button_13 = CreateButton(ButtonName="Reset", ButtonStyle=0)
values_26 = ValueListener(Elements=button_13, SomeProperty=True)  # -> Values, Indices
pickbtn_13 = CreateRhinoPickButton(
    ButtonName=panel_3,
    Prompt="Please select geometry...",
    AllowMultiple=True,
    AllowNone=values_26.Values,
    Type=0,
    ButtonStyle=0)
values_27 = ValueListener(Elements=pickbtn_13, SomeProperty=True)  # -> Values, Indices
stack_13 = CreateStack(UIElements=[pickbtn_13, button_13], Horizontal=True)

# ----
# Add Vias UI
panel_4 = Panel("Add Vias")
button_14 = CreateButton(ButtonName="Reset", ButtonStyle=0)
values_28 = ValueListener(Elements=button_14, SomeProperty=True)  # -> Values, Indices
pickbtn_14 = CreateRhinoPickButton(
    ButtonName=panel_4,
    Prompt="Please select geometry...",
    AllowMultiple=True,
    AllowNone=values_28.Values,
    Type=0,
    ButtonStyle=0)
values_29 = ValueListener(Elements=pickbtn_14, SomeProperty=True)  # -> Values, Indices
stack_14 = CreateStack(UIElements=[pickbtn_14, button_14], Horizontal=True)

# ----
# Draw Sockets + Radius & Height UI
socket_radius = Slider(0.5, range=0..3)
socket_height = Slider(2, range=0..3)
slider_2 = CreateSlider(Slider=socket_radius, ShowBounds=False, ShowTicks=False, ShowTooltip=False, ShowValLabel=True, showLabel=True)
slider_3 = CreateSlider(Slider=socket_height, ShowBounds=False, ShowTicks=False, ShowTooltip=False, ShowValLabel=True, showLabel=True)
values_30 = ValueListener(Elements=slider_2, SomeProperty=True)  # -> PitchDimension, Indices
values_31 = ValueListener(Elements=slider_3, SomeProperty=True)  # -> PitchDimension, Indices
stack_15 = CreateStack(UIElements=[slider_2, slider_3], Horizontal=True)
pl = ConstructPlane(Origin=values_27.Values, XAxis=Vector(1, 0, 0), YAxis=Vector(0, 1, 0))
cyl = Cylinder(Base=pl, Radius=values_30.PitchDimension, Length=values_31.PitchDimension)
cap = CapHoles(Brep=cyl)

label = CreateLabel(LabelText="Sockets", LabelSize=24, Justification=0)
label_2 = CreateLabel(LabelText="Vias", LabelSize=24, Justification=0)

# ----
# Construct Pitch Grid
brep_2 = Brep(brep)
cluster = Cluster(B=brep_2)  # -> top_surface, bottom_surface
_2d_surface_analysis = _2DSurfaceAnalysis(S=cluster.top_surface, pitch_dimension=values_25.PitchDimension)  # -> lines, flatten(nodes), no_of_nodes
_2d_surface_analysis_2 = _2DSurfaceAnalysis(S=cluster.bottom_surface, pitch_dimension=values_25.PitchDimension)  # -> lines, flatten(nodes), no_of_nodes
toggle = BooleanToggle(False)
sphere = Sphere(Base=[_2d_surface_analysis.nodes, _2d_surface_analysis_2.nodes], Radius=Slider(0.09, range=0..1))
stream_filter = StreamFilter(Gate=gate_not, Stream0=sphere)
crv = Curve([_2d_surface_analysis.lines, _2d_surface_analysis_2.lines])
colour_picker = ColourPicker(PickedColour=RGB(219, 222, 197))
custom_preview = CustomPreview(Geometry=stream_filter, Material=colour_picker)
colour_2 = ColourPicker(PickedColour=RGB(220, 210, 250))
preview_2 = CustomPreview(Geometry=crv, Material=colour_2)
crv_2 = Curve(flatten([_2d_surface_analysis.lines, _2d_surface_analysis_2.lines]))

# ----
# Visualize Circle Before Baking & Create Interconnex Layer
panel_5 = Panel("Orange")
divide_surface = DivideSurface(Surface=cluster.top_surface, UCount=10, VCount=10)  # -> Points, Normals, Parameters
divide_surface_2 = DivideSurface(Surface=cluster.bottom_surface, UCount=10, VCount=10)  # -> Points, Normals, Parameters
create_modify_layers = CreateModifyLayers(LayerName="Interconnex", LayerColor=panel_5, DeleteLayer=False, enableFullPath=False)  # -> LayerNames, LayerFullPath
distance = Distance(PointA=divide_surface.Points, PointB=divide_surface_2.Points)
flatten_tree = FlattenTree(Tree=distance, Path="{0}")
list_item = ListItem(List=flatten_tree, Index="0", Wrap=True)
colour_3 = ColourPicker(PickedColour=RGB(255, 186, 186))
preview_3 = CustomPreview(Geometry=cluster.bottom_surface, Material=colour_3)
colour_4 = ColourPicker(PickedColour=RGB(255, 255, 255))
preview_4 = CustomPreview(Geometry=cluster.top_surface, Material=colour_4)

qb = QuickBaker(
    Geometry=flatten([_2d_surface_analysis.nodes, _2d_surface_analysis_2.nodes]),
    Layer="nodes",
    Bake=<missing>,
    referenceAll=1)

# ----
# Connect
merge = Merge(
    Data1=stack_2,
    Data2=stack_4,
    Data3=stack_5,
    Data4=stack_8,
    Data5=stack_10,
    Data6=stack_11,
    Data7=stack_9,
    Data8=stack_7,
    Data9=stack,
    Data10=stack_6,
    Data11=stack_3)
interconnect = INTERCONNECT(
    underlying_grid=flatten(crv_2),
    ap=values_4.Values,
    bp=values_8.Values,
    cp=values_10.Values,
    dp=values_16.Values,
    ep=values_20.Values,
    fp_7=values_22.Values,
    fp_3=values_18.Values,
    fp_5=values_14.Values,
    fp_2=values_2.Values,
    fp_4=values_12.Values,
    fp_6=values_6.Values)  # -> A, B, C, D_9, D_7, D_8, D_3, D_5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

# ----
# Circle Baking Validating & Reseting UI
panel_6 = Panel("Validate")
create_button = CreateButton(ButtonName=panel_6, ButtonStyle=0)
create_button_2 = CreateButton(ButtonName="Reset", ButtonStyle=0)
value_listener_2 = ValueListener(Elements=create_button_2, SomeProperty=True)  # -> Values, Indices
value_listener_3 = ValueListener(Elements=create_button, SomeProperty=True)  # -> Values, Indices
create_stack = CreateStack(UIElements=[create_button, create_button_2], Horizontal=True)
geometry_pipeline = GeometryPipeline(
    GroupByLayer=False,
    GroupByType=False,
    IncludeHidden=True,
    IncludeLocked=True,
    LayerFilter="Circles",
    NameFilter="*",
    SublayerFiltering=True,
    TypeFilter=1073741852)
deleteonlayer = DeleteOnLayer(Run=value_listener_2.Values, Layer="Circles", enableFullPath=False)

object_bake = ObjectBake(
    BakeToggle=value_listener_3.Values,
    GeometryObjects=[_2d_surface_analysis.nodes, _2d_surface_analysis_2.nodes],
    Layer="Circles",
    ObjectName="GH_Obj",
    ObjectColor=RGB(255, 255, 255),
    LayerColor=RGB(255, 255, 255))

# ----
# Display Number of Nodes
panel_7 = Panel("no.nodes")
label_3 = CreateLabel(LabelText=panel_7, LabelSize=12, Justification=0)
label_4 = CreateLabel(LabelText="Number of Nodes :", LabelSize=12, Justification=0)
setlabel = SetLabelContents(LabelToModify=label_3, NewLabelContents=_2d_surface_analysis.no_of_nodes)
stack_16 = CreateStack(UIElements=[label_4, label_3], Horizontal=True)

# ----
# Num of Interconnect + Grid
panel_8 = Panel("No. of Interconnect")
series = Series(Start=0, Step=1, Count=Slider(11, range=0..100))
pulldown = CreatePulldownMenu(Label=panel_8, ListItems=series, showLabel=True)
values_32 = ValueListener(Elements=pulldown, SomeProperty=True)  # -> Values, Indices
subtraction = Subtraction(A=values_32.Values, B="0")
split = SplitList(List=merge, Index=subtraction)  # -> ListA, ListB
simplegrid = CreateSimpleGrid(UIElements=split.ListA, RowDefinitions="2*", ColumnDefinitions="2*")

# ----
# Num of Interconnect + Grid
panel_9 = Panel("Interconnect")
label_5 = CreateLabel(LabelText=panel_9, LabelSize=24, Justification=0)
merge_2 = Merge(Data2=label_5, Data3=pulldown, Data4=simplegrid)

# ----
# Interconnect Width & Height UI
interconnect_width = Slider(1.5, range=0.2..3)
interconnect_height = Slider(0.5, range=0..2)
slider_4 = CreateSlider(Slider=interconnect_width, ShowBounds=False, ShowTicks=False, ShowTooltip=False, ShowValLabel=True, showLabel=True)
values_33 = ValueListener(Elements=slider_4, SomeProperty=True)  # -> Values, Indices
slider_5 = CreateSlider(Slider=interconnect_height, ShowBounds=False, ShowTicks=False, ShowTooltip=False, ShowValLabel=True, showLabel=True)
values_34 = ValueListener(Elements=slider_5, SomeProperty=True)  # -> Values, Indices

crv_3 = Curve(graft([interconnect.A, interconnect.B, interconnect.C, interconnect.D_9, interconnect.D_7, interconnect.D_8, interconnect.D_3, interconnect.D_5, interconnect.D_2, interconnect.D_4, interconnect.D_6, interconnect.D]))
division = Division(A=values_33.Values, B=Slider(2, range=0..10))
neg = Negative(Value=division)
dom = ConstructDomain(DomainStart=neg, DomainEnd=division)
pframe = PerpFrame(Curve=reparameterize(crv_3), Parameter=Slider(0, range=0..100))

# ----
# Extrude Direction
end = EndPoints(Curve=crv_3)  # -> Start, End
pdecon = Deconstruct(Point=end.Start)  # -> XComponent, YComponent, ZComponent
clean = CleanTree(RemoveNulls=True, RemoveInvalid=True, RemoveEmpty=False, Tree=pdecon.ZComponent)
number_slider = Slider(1, range=0..1)
item = ListItem(List=clean, Index=0, Wrap=True)
smaller = SmallerThan(FirstNumber=item, SecondNumber=Slider(0, range=0..100))  # -> SmallerThan, OrEqualTo
num = Number(smaller.OrEqualTo)
panel_10 = Panel(num)
replace = ReplaceMembers(Set=num, Find=Slider(0, range=0..100), Replace=Slider(-1, range=-1..1))

multiplication = Multiplication(A=values_34.Values, B=replace)
panel_11 = Panel(smaller.OrEqualTo)

rectangle = Rectangle(Plane=pframe, XSize=multiplication, YSize=dom, Radius=0)  # -> Rectangle, Length
swp1 = Sweep1(Rail=crv_3, Sections=rectangle.Rectangle, Miter=1)
cap_2 = CapHoles(Brep=swp1)

panel_12 = Panel(replace)

# ----
# Export Traces UI & Baking
panel_13 = Panel("Export the traces")
toggle_2 = CreateToggle(Default=Toggle(False), Label=panel_13)
values_35 = ValueListener(Elements=toggle_2, SomeProperty=True)  # -> Values, Indices

# ----
# UI Generator
panel_14 = Panel(" ")
label_6 = CreateLabel(LabelText=panel_14, LabelSize=12, Justification=0)
label_7 = CreateLabel(LabelText="Node Generation", LabelSize=24, Justification=0)
label_8 = CreateLabel(LabelText="Pick Model", LabelSize=24, Justification=0)
merge_3 = Merge(
    Data1=label_8,
    Data2=stack_12,
    Data4=label_6,
    Data5=slider,
    Data6=label_7,
    Data7=create_toggle,
    Data9=create_stack,
    Data10=stack_16)
merge_4 = Merge(Data1=merge_3)
panel_15 = Panel("""Circuit Drawing
Add Geometry
Export""")

# ----
# Boolean Difference for Final Shape
brep_3 = Brep(brep)
sdiff = SolidDifference(BrepsA=graft(brep_3), BrepsB=flatten(cap_2))
null = NullItem(Item=sdiff)  # -> NullFlags, InvalidFlags, Description
colour_5 = ColourPicker(PickedColour=RGBA(217, 217, 217, 145))

# ----
# Draw Interconnect
colour_6 = ColourPicker(PickedColour=RGB(255, 148, 77))

# ----
# Export Substrate UI & Create Substrate Layer
toggle_3 = BooleanToggle(False)
toggle_4 = CreateToggle(Default=Toggle(False), Label="Export Substrate")
stack_17 = CreateStack(UIElements=[toggle_2, toggle_4], Horizontal=toggle_3)  # -> flatten(Stack)
values_36 = ValueListener(Elements=toggle_4, SomeProperty=True)  # -> Values, Indices

stack_18 = CreateStack(UIElements=[slider_4, slider_5, toggle_4], Horizontal=False)  # -> flatten(Stack)

# ----
# Draw Vias
number_slider_2 = Slider(1, range=0..1)
item_2 = ListItem(List=flatten(item), Index=0, Wrap=True)  # -> flatten(Item)
abs = Absolute(Value=item_2)
hole_radius = Slider(1, range=0..3)
multiplication_2 = Multiplication(A=number_slider_2, B=list_item)
neg_2 = Negative(Value=multiplication_2)
Z = UnitZ(Factor=neg_2)
slider_6 = CreateSlider(Slider=hole_radius, ShowBounds=False, ShowTicks=False, ShowTooltip=False, ShowValLabel=True, showLabel=True)
number_slider_3 = Slider(-1, range=-1..1)
values_37 = ValueListener(Elements=slider_6, SomeProperty=True)  # -> PitchDimension, Indices
abs_2 = Absolute(Value=number_slider_3)
addition = Addition(A=values_37.PitchDimension, B=abs_2)

pl_2 = ConstructPlane(Origin=values_29.Values, XAxis=Vector(1, 0, 0), YAxis=Vector(0, 1, 0))
number_slider_4 = Slider(2, range=0..10)
neg_3 = Negative(Value=Slider(5, range=1..10))
cyl_2 = Cylinder(Base=pl_2, Radius=values_37.PitchDimension, Length=neg_3)
edges = BrepEdges(Brep=cyl_2)  # -> Naked, Interior, NonManifold
item_3 = ListItem(List=edges.Naked, Index=Slider(1, range=0..1), Wrap=True)

merge_5 = Merge(
    Data3=merge_2,
    Data4=stack_18,
    Data5=label_2,
    Data6=stack_17,
    Data7=stack_14,
    Data9=slider_6,
    Data10=label,
    Data11=stack_13,
    Data12=stack_15,
    Data13=merge_2,
    Data14=stack_18)
tabs = TabbedView(TabNames=panel_15, Tab0=flatten(merge_5), Tab1=flatten(merge_4), Tab2=flatten(stack_17))
addelems = AddElements(Window=launchwin, Elements=flatten(tabs), DoVLChecking=True)  # -> AddedElements, ElementNames

merge_6 = Merge(Data1=merge_4, Data2=merge_5, Data3=stack_17)

extr = Extrude(Base=item_3, Direction=Z)
cap_3 = CapHoles(Brep=extr)
offset = OffsetSurface(Surface=extr, Distance=number_slider_3, Retrim=Toggle(False))
cap_4 = CapHoles(Brep=offset)
sdiff_2 = SolidDifference(BrepsA=cap_4, BrepsB=cap_3)
cyl_3 = Cylinder(Base=pl_2, Radius=addition, Length=neg_3)
cir = Circle(Plane=pl_2, Radius=addition)

sdiff_3 = SolidDifference(BrepsA=cap_2, BrepsB=cyl_2)
null_2 = NullItem(Item=sdiff_3)  # -> NullFlags, InvalidFlags, Description
filter = StreamFilter(Gate=null_2.NullFlags, Stream0=[sdiff_3, sdiff_2], Stream1=cap_2)
preview_5 = CustomPreview(Geometry=[filter, sdiff_2, cap], Material=colour_6)

bake_objects = BakeObjects(Geometry=[cap, sdiff_2, sdiff_3], Bake=values_35.Values, createGroups=False)  # -> Message, Ghosts

sdiff_4 = SolidDifference(BrepsA=sdiff, BrepsB=cyl_3)
null_3 = NullItem(Item=sdiff_4)  # -> NullFlags, InvalidFlags, Description
filter_2 = StreamFilter(Gate=null.NullFlags, Stream0=sdiff_4, Stream1=brep_3)
filter_3 = StreamFilter(Gate=null_3.NullFlags, Stream0=sdiff_4, Stream1=sdiff)
preview_6 = CustomPreview(Geometry=[filter_2, filter_3], Material=colour_5)

object_bake_2 = ObjectBake(
    BakeToggle=values_36.Values,
    GeometryObjects=sdiff_4,
    Layer="Substrate",
    ObjectName="GH_Obj",
    ObjectColor=RGB(255, 255, 255),
    LayerColor=RGB(255, 255, 255))

# ==== cluster _2DSurfaceAnalysis
pitch_dimension = ClusterInput()
S = ClusterInput()
dim = Dimensions(Surface=S)  # -> UDimension, VDimension
division = Division(A=dim.UDimension, B=pitch_dimension)
division_2 = Division(A=dim.VDimension, B=pitch_dimension)
sdivide = DivideSurface(Surface=S, UCount=division, VCount=division_2)  # -> simplify(flatten(Points)), Normals, Parameters
clean = CleanTree(RemoveNulls=True, RemoveInvalid=True, RemoveEmpty=False, Tree=sdivide.Points)
pt = Point(simplify(flatten(clean)))
pt_2 = Point(simplify(graft(clean)))
cps = ClosestPoints(Point=pt_2, Cloud=pt, Count=Slider(9, range=0..10))  # -> ClosestPoint, CPIndex, Distance
lng = ListLength(List=pt)
ln = Line(StartPoint=pt_2, EndPoint=cps.ClosestPoint)
no_of_nodes = ClusterOutput(lng)
lines = ClusterOutput(ln)
nodes = ClusterOutput(pt)

# ==== cluster INTERCONNECT
underlying_grid = ClusterInput()
ap = ClusterInput()
fp = ClusterInput()
bp = ClusterInput()
fp_2 = ClusterInput()
fp_3 = ClusterInput()
fp_4 = ClusterInput()
fp_5 = ClusterInput()
fp_6 = ClusterInput()
cp = ClusterInput()
ep = ClusterInput()
fp_7 = ClusterInput()
dp = ClusterInput()
path_planning = PathPlanning(V=bp)
path_planning_2 = PathPlanning(V=ap)
path_planning_3 = PathPlanning_2(V=fp)
path_planning_4 = PathPlanning_2(V=fp_2)
path_planning_5 = PathPlanning_2(V=fp_3)
path_planning_6 = PathPlanning_2(V=fp_4)
path_planning_7 = PathPlanning_2(V=fp_5)
path_planning_8 = PathPlanning_2(V=fp_6)
path_planning_9 = PathPlanning_2(V=cp)
path_planning_10 = PathPlanning_2(V=ep)
path_planning_11 = PathPlanning_2(V=fp_7)
path_planning_12 = PathPlanning_2(V=dp)
shortwalk = ShortestWalk(Curves=underlying_grid, WantedPath=path_planning_3)  # -> ShortestWalk, Succession, Direction, Length
shortwalk_2 = ShortestWalk(Curves=underlying_grid, WantedPath=path_planning_4)  # -> ShortestWalk, Succession, Direction, Length
shortwalk_3 = ShortestWalk(Curves=underlying_grid, WantedPath=path_planning_5)  # -> ShortestWalk, Succession, Direction, Length
shortwalk_4 = ShortestWalk(Curves=underlying_grid, WantedPath=path_planning_6)  # -> ShortestWalk, Succession, Direction, Length
shortwalk_5 = ShortestWalk(Curves=underlying_grid, WantedPath=path_planning_7)  # -> ShortestWalk, Succession, Direction, Length
shortwalk_6 = ShortestWalk(Curves=underlying_grid, WantedPath=path_planning_8)  # -> ShortestWalk, Succession, Direction, Length
shortwalk_7 = ShortestWalk(Curves=underlying_grid, WantedPath=path_planning)  # -> ShortestWalk, Succession, Direction, Length
shortwalk_8 = ShortestWalk(Curves=underlying_grid, WantedPath=path_planning_11)  # -> ShortestWalk, Succession, Direction, Length
shortwalk_9 = ShortestWalk(Curves=underlying_grid, WantedPath=path_planning_9)  # -> ShortestWalk, Succession, Direction, Length
shortwalk_10 = ShortestWalk(Curves=underlying_grid, WantedPath=path_planning_2)  # -> ShortestWalk, Succession, Direction, Length
shortwalk_11 = ShortestWalk(Curves=underlying_grid, WantedPath=path_planning_10)  # -> ShortestWalk, Succession, Direction, Length
shortwalk_12 = ShortestWalk(Curves=underlying_grid, WantedPath=path_planning_12)  # -> ShortestWalk, Succession, Direction, Length
join = JoinCurves(Curves=shortwalk_7.ShortestWalk, Preserve=False)
join_2 = JoinCurves(Curves=shortwalk_9.ShortestWalk, Preserve=False)
join_3 = JoinCurves(Curves=shortwalk_10.ShortestWalk, Preserve=False)
join_4 = JoinCurves(Curves=shortwalk_11.ShortestWalk, Preserve=False)
join_5 = JoinCurves(Curves=shortwalk.ShortestWalk, Preserve=False)
join_6 = JoinCurves(Curves=shortwalk_2.ShortestWalk, Preserve=False)
join_7 = JoinCurves(Curves=shortwalk_3.ShortestWalk, Preserve=False)
join_8 = JoinCurves(Curves=shortwalk_4.ShortestWalk, Preserve=False)
join_9 = JoinCurves(Curves=shortwalk_5.ShortestWalk, Preserve=False)
join_10 = JoinCurves(Curves=shortwalk_6.ShortestWalk, Preserve=False)
join_11 = JoinCurves(Curves=shortwalk_8.ShortestWalk, Preserve=False)
join_12 = JoinCurves(Curves=shortwalk_12.ShortestWalk, Preserve=False)
pline = PolyLine(Closed=False)
pline_2 = PolyLine(Closed=False)
pull = PullCurve()
pull_2 = PullCurve(Curve=pline)
pull_3 = PullCurve()
pull_4 = PullCurve(Curve=pline_2)
midpt = CurveMiddle()
midpt_2 = CurveMiddle()
midpt_3 = CurveMiddle()
midpt_4 = CurveMiddle()
midpt_5 = CurveMiddle()
midpt_6 = CurveMiddle()
c_script = CSharpScript(T="5", P=midpt)  # -> out, A; inputs T: String, P: Point3d
# ---------- c_script: C# usings ----------
using System.IO;
using System.Linq;
using System.Data;
using System.Drawing;
using System.Reflection;
using System.Windows.Forms;
using System.Xml;
using System.Xml.Linq;
using System.Runtime.InteropServices;

using Rhino.DocObjects;
using Rhino.Collections;
using GH_IO;
using GH_IO.Serialization;
# ---------- c_script: C# ----------
    _text.Add(T);
    _points.Add(P);
# ---------- c_script: C# additional code ----------
  private readonly List<string> _text = new List<string>();
  private readonly List<Point3d> _points = new List<Point3d>();

  /// <summary>
  /// This method will be called once every solution, before any calls to RunScript.
  /// </summary>
  public override void BeforeRunScript()
  {
    _text.Clear();
    _points.Clear();
  }

  //Draw all meshes in this method.
  public override void DrawViewportMeshes(IGH_PreviewArgs args)
  {
    for (int i = 0; i < _text.Count; i++)
    {
      Plane plane ;
      args.Viewport.GetCameraFrame(out plane);
      plane.Origin = _points[i];

      args.Display.Draw3dText(_text[i], Color.Black, plane, 1.5, "Lucida Console");
    }
  }
# ---------- end c_script ----------
c_script_2 = CSharpScript(T="6", P=midpt_2)  # -> out, A; inputs T: String, P: Point3d; same code as c_script
c_script_3 = CSharpScript(T="4", P=midpt_4)  # -> out, A; inputs T: String, P: Point3d; same code as c_script
c_script_4 = CSharpScript(T="1", P=midpt_6)  # -> out, A; inputs T: String, P: Point3d
# ---------- c_script_4: C# ----------
    _text.Add(T);
    _points.Add(P);
# ---------- c_script_4: C# additional code ----------
  private readonly List<string> _text = new List<string>();
  private readonly List<Point3d> _points = new List<Point3d>();

  /// <summary>
  /// This method will be called once every solution, before any calls to RunScript.
  /// </summary>
  public override void BeforeRunScript()
  {
    _text.Clear();
    _points.Clear();
  }

  //Draw all meshes in this method.
  public override void DrawViewportMeshes(IGH_PreviewArgs args)
  {
    for (int i = 0; i < _text.Count; i++)
    {
      Plane plane ;
      args.Viewport.GetCameraFrame(out plane);
       plane.Origin = _points[i];

      args.Display.Draw3dText(_text[i], Color.Black, plane, 1.5, "Lucida Console");
    }
  }
# ---------- end c_script_4 ----------
c_script_5 = CSharpScript(T="3", P=midpt_5)  # -> out, A; inputs T: String, P: Point3d; same code as c_script
c_script_6 = CSharpScript(T="2", P=midpt_3)  # -> out, A; inputs T: String, P: Point3d
# ---------- c_script_6: C# ----------
    _text.Add(T);
    _points.Add(P);
# ---------- c_script_6: C# additional code ----------
  private readonly List<string> _text = new List<string>();
  private readonly List<Point3d> _points = new List<Point3d>();

  /// <summary>
  /// This method will be called once every solution, before any calls to RunScript.
  /// </summary>
  public override void BeforeRunScript()
  {
    _text.Clear();
    _points.Clear();
  }

  //Draw all meshes in this method.
  public override void DrawViewportMeshes(IGH_PreviewArgs args)
  {
    for (int i = 0; i < _text.Count; i++)
    {
      Plane plane ;
      args.Viewport.GetCameraFrame(out plane);
         plane.Origin = _points[i];

      args.Display.Draw3dText(_text[i], Color.Black, plane, 1.5, "Lucida Console");
    }
  }
# ---------- end c_script_6 ----------
D = ClusterOutput(join_5)
D_2 = ClusterOutput(join_6)
D_3 = ClusterOutput(join_7)
D_4 = ClusterOutput(join_8)
D_5 = ClusterOutput(join_9)
D_6 = ClusterOutput(join_10)
D_7 = ClusterOutput(join_4)
D_8 = ClusterOutput(join_11)
B = ClusterOutput(join)
C = ClusterOutput(join_2)
A = ClusterOutput(join_3)  # A
D_9 = ClusterOutput(join_12)

# ==== cluster Cluster
B = ClusterInput()
debrep = DeconstructBrep(Brep=B)  # -> Faces, Edges, Vertices
area = Area(Geometry=debrep.Faces)  # -> Area, Centroid
pdecon = Deconstruct(Point=area.Centroid)  # -> XComponent, YComponent, ZComponent
sort = SortList(Keys=pdecon.ZComponent, ValuesA=debrep.Faces)  # -> Keys, ValuesA
lng = ListLength(List=sort.ValuesA)
subtraction = Subtraction(A=lng, B=Slider(1, range=0..1))
item = ListItem(List=sort.ValuesA, Index=subtraction, Wrap=True)
item_2 = ListItem(List=sort.ValuesA, Index=Slider(0, range=0..10), Wrap=True)
bottom_surface = ClusterOutput(item_2)
top_surface = ClusterOutput(item)

# ==== cluster PathPlanning
V = ClusterInput()
pt1 = ClusterInput()
pt2 = ClusterInput()
pt = Point(flatten(pt2))
pt_2 = Point(flatten(pt1))

pline = PolyLine(Vertices=V, Closed=False)
end = EndPoints(Curve=pline)  # -> Start, End
ln = Line(StartPoint=pt_2, EndPoint=end.Start)
ln_2 = Line(StartPoint=end.End, EndPoint=pt)
ln_3 = Line(StartPoint=pt_2, EndPoint=pt)
explode = Explode(Curve=[ln_2, ln, pline], Recursive=True)  # -> simplify(flatten(Segments)), Vertices
lng = ListLength(List=flatten(explode.Segments))  # -> flatten(Length)
null = NullItem(Item=lng)  # -> NullFlags, InvalidFlags, Description
bool = Boolean(invert(null.NullFlags))

panel = Panel(pt_2)
panel_2 = Panel(pt)
filter = StreamFilter(Gate=bool, Stream0=ln_3, Stream1=explode.Segments)
item = ListItem(List=filter, Index=Slider(1, range=0..1), Wrap=True)
panel_3 = Panel(filter)
s_1 = ClusterOutput(filter)

# ==== cluster PathPlanning_2
V = ClusterInput()
pt1 = ClusterInput()
pt2 = ClusterInput()
pt = Point(flatten(pt2))
pt_2 = Point(flatten(pt1))

pline = PolyLine(Vertices=V, Closed=False)
end = EndPoints(Curve=pline)  # -> Start, End
ln = Line(StartPoint=pt_2, EndPoint=end.Start)
ln_2 = Line(StartPoint=end.End, EndPoint=pt)
ln_3 = Line(StartPoint=pt_2, EndPoint=pt)
explode = Explode(Curve=[ln_2, ln, pline], Recursive=True)  # -> simplify(flatten(Segments)), Vertices
lng = ListLength(List=flatten(explode.Segments))  # -> flatten(Length)
null = NullItem(Item=lng)  # -> NullFlags, InvalidFlags, Description
bool = Boolean(invert(null.NullFlags))

panel = Panel(pt_2)
panel_2 = Panel(pt)
filter = StreamFilter(Gate=bool, Stream0=ln_3, Stream1=explode.Segments)
item = ListItem(List=filter, Index=Slider(1, range=0..1), Wrap=True)
panel_3 = Panel(filter)
s_0 = ClusterOutput(filter)
